# Grasshopper definition sectiondrawer.gh (Grasshopper 0.9.76)
# plug-ins: Python Interpreter, Human UI

# ---- group: 切断線
crv = Curve()

# ----
pt = Point()
panel = Panel("""平面図のみ
断面図のみ
両方""")
panel_2 = Panel("""main
option""")
listbox = CreateListBox(ListItems=panel, SelectedIndex=0, Height=Slider(80, range=0..100))
launchwin = LaunchWindow(
    Show=Toggle(False),
    Name="Control Window",
    Width=Slider(380, range=0..1000),
    Height=400,
    ChildStatus=1,
    EnableHorizScroll=False)
accent_colors = ValueList({"Amber", "Blue", "Brown", "Cobalt", "Crimson", "Cyan", "Emerald", "Green", "Indigo", "Lime", "Magenta", "Mauve", "Olive", "Orange", "Pink", "Purple", "Red", "Sienna", "Steel", "Taupe", "Teal", "Violet", "Yellow"}, selected="Amber")
values = ValueListener(Elements=listbox, SomeProperty=True)  # -> Values, Indices
expander = CreateExpander(UIElements=listbox, Header="モード選択", Open=False)
winprops = SetWindowProperties(Window=launchwin, Theme=0, AccentColor=accent_colors, ShowTitleBar=True, ScaleFactor=1)
values_2 = ValueListener(Elements=expander, SomeProperty=True)  # -> Values, Indices
toggle = BooleanToggle(True)
toggle_2 = BooleanToggle(False)
setexp = SetExpander(Expander=expander, ExpandedOpen=values_2.Values)
merge = Merge(Data1=toggle, Data2=toggle)
merge_2 = Merge(Data1=toggle, Data2=toggle_2)
merge_3 = Merge(Data1=toggle_2, Data2=toggle)
filter = StreamFilter(Gate=values.Indices, Stream0=merge_2, Stream1=merge_3, Stream2=merge)
crv_2 = Curve(crv)
item = ListItem(List=filter, Index=0, Wrap=True)  # -> Item, Item1
bool = Boolean(item.Item1)
bool_2 = Boolean(item.Item)
lng = ListLength(List=crv_2)
end = EndPoints(Curve=crv_2)  # -> Start, End
series = Series(Start=0, Step=1, Count=lng)
サーフェスの大きさ = Slider(50000, range=-1..100000)
方向の目印 = Slider(10000, range=0..10000)
基点の目印 = Slider(1, range=0..1)
merge_4 = Merge(Data1=graft(end.Start), Data2=graft(end.End))
int = Integer(series)
tag = TextTag3D(Location=merge_4, Text=graft(int), Size=Slider(4010, range=0..4010), Justification=7)
textbox = CreateTextBox(DefaultText="name", UpdateButton=False, showLabel=True)
filepicker = CreateFilePicker(ButtonLabelText="browse", DialogType=2, MustExist=True, Filter="All Files|*.*")
tb = CreateTextBlock(Text="□平面図ーーーーーーーーーーーーーーーーーーーーーーーーー", TextSize=16, Justification=0)
tb_2 = CreateTextBlock(Text="□断面図ーーーーーーーーーーーーーーーーーーーーーーーーー", TextSize=16, Justification=0)
tb_3 = CreateTextBlock(Text="□保存先ーーーーーーーーーーーーーーーーーーーーーーーーー", TextSize=16, Justification=0)
button = CreateButton(ButtonName="次の切断線を設定する", ButtonStyle=0)
button_2 = CreateButton(ButtonName="戻る", ButtonStyle=0)
checkbox = CreateCheckbox(Label="曲線を反転", StartingValue=False)
tb_4 = CreateTextBlock(Text="□実行ーーーーーーーーーーーーーーーーーーーーーーーーーーー", TextSize=16, Justification=0)
slider = CreateSlider(
    Slider=基点の目印,
    SnapValue=Slider(0.1, range=0..0.1),
    ShowBounds=False,
    showLabel=True,
    ShowTicks=False,
    ShowTooltip=False,
    ShowValLabel=True)
slider_2 = CreateSlider(
    Slider=方向の目印,
    SnapValue=Slider(1000, range=0..1000),
    ShowBounds=False,
    showLabel=True,
    ShowTicks=False,
    ShowTooltip=False,
    ShowValLabel=True)
button_3 = CreateButton(ButtonName="リセット", ButtonStyle=0)
toggle_3 = CreateToggle(Default=False, OnLabel=" on", OffLabel=" off")
slider_3 = CreateSlider(
    Slider=サーフェスの大きさ,
    SnapValue=Slider(10000, range=0..10000),
    ShowBounds=False,
    showLabel=True,
    ShowTicks=False,
    ShowTooltip=False,
    ShowValLabel=True)
textbox_2 = CreateTextBox(DefaultText="-1500/0/1500", UpdateButton=False, showLabel=True)
hideshow = HideShowElement(ElementToHideShow=tb, Show=bool_2, Collapse=True, Disable=False)
hideshow_2 = HideShowElement(ElementToHideShow=tb_2, Show=bool, Collapse=True, Disable=False)
hideshow_3 = HideShowElement(ElementToHideShow=button, Show=bool, Collapse=True, Disable=False)
hideshow_4 = HideShowElement(ElementToHideShow=button_2, Show=bool, Collapse=True, Disable=False)
hideshow_5 = HideShowElement(ElementToHideShow=checkbox, Show=bool, Collapse=True, Disable=False)
stack = CreateStack(UIElements=[button_2, button], Horizontal=True)
entwine = Entwine(Branch00=slider, Branch01=slider_2, Branch02=slider_3, FlattenInputs=True)
adjustpos = AdjustElementPositioning(ElementsToAdjust=toggle_3, Margin="0", AbsolutePositioning=False, HorizontalAlignment=1)
adjustpos_2 = AdjustElementPositioning(ElementsToAdjust=button, AbsolutePositioning=False, Width=Slider(280, range=0..1000), Height=Slider(50, range=0..1000))
adjustpos_3 = AdjustElementPositioning(
    ElementsToAdjust=filepicker,
    Margin="0",
    AbsolutePositioning=False,
    Width=Slider(332, range=0..1000),
    Height=Slider(30, range=0..1000))
adjustelem = AdjustElementAppearance(ElementsToAdjust=[tb_4, tb, tb_2, tb_3], Foreground=ColourSwatch(SwatchColor=RGB(196, 134, 0)))
values_3 = ValueListener(Elements=slider_3, SomeProperty=True)  # -> Values, Indices
values_4 = ValueListener(Elements=toggle_3, SomeProperty=True)  # -> Values, Indices
values_5 = ValueListener(Elements=checkbox, SomeProperty=True)  # -> Values, Indices
values_6 = ValueListener(Elements=button, SomeProperty=True)  # -> Values, Indices
values_7 = ValueListener(Elements=button_2, SomeProperty=True)  # -> Values, Indices
values_8 = ValueListener(Elements=textbox, SomeProperty=True)  # -> Values, Indices
values_9 = ValueListener(Elements=filepicker, SomeProperty=True)  # -> Values, Indices
values_10 = ValueListener(Elements=button_3, SomeProperty=True)  # -> Values, Indices
values_11 = ValueListener(Elements=slider, SomeProperty=True)  # -> Values, Indices
values_12 = ValueListener(Elements=slider_2, SomeProperty=True)  # -> Values, Indices
values_13 = ValueListener(Elements=textbox_2, SomeProperty=True)  # -> Values, Indices
entwine_2 = Entwine(
    Branch00=expander,
    Branch01=tb,
    Branch03=textbox_2,
    Branch04=tb_2,
    Branch07=stack,
    Branch08=checkbox,
    Branch09=tb_3,
    Branch011=textbox,
    Branch012=filepicker,
    Branch013=tb_4,
    Branch014=toggle_3,
    FlattenInputs=True)
setslider = SetSlider(UISlider=slider_3, Value=values_3.Values)
setslider_2 = SetSlider(UISlider=slider_2, Value=values_12.Values)
setslider_3 = SetSlider(UISlider=slider, Value=values_11.Values)
split = TextSplit(Text=values_13.Values, Separators="/")
len = TextLength(Text=values_9.Values)
int_2 = Integer(split)
equals = Equality(FirstNumber=len, SecondNumber="0")  # -> Equality, Inequality
tabs = TabbedView(TabNames=panel_2, TabTextSize=Slider(20, range=0..100), Tab0=flatten(entwine_2), Tab1=flatten(entwine))
filter_2 = StreamFilter(Gate=equals.Equality, Stream0=values_9.Values, Stream1="D:\drawing\")
concat = Concatenate(FragmentA=filter_2, FragmentB="\")
addelems = AddElements(Window=launchwin, Elements=flatten(tabs), DoVLChecking=True)  # -> AddedElements, ElementNames
file = ReadFile(File="D:\python\sectiondrawer\sectiondrawer\sectiondrawer.py", PerLineParse=False)
python = PythonScript(
    Code=file,
    Point_p=pt,
    Curve_s=crv_2,
    Mode=values.Indices,
    Height=int_2,
    Reverse=values_5.Values,
    Directory=concat,
    Name=values_8.Values,
    Reset=values_10.Values,
    Next=values_6.Values,
    Undo=values_7.Values,
    Draw=values_4.Values,
    Parameter=values_11.Values,
    Mark=values_12.Values,
    Width=values_3.Values)  # -> Out, Direction, Circle, Center, Len_p, Len_s
panel_3 = Panel(python.Out)
data = Data(values_3.Values)
division = Division(A=data, B=2)
geo = Geometry(python.Center)
neg = Negative(Value=division)
dom = ConstructDomain(DomainStart=division, DomainEnd=neg)
rectangle = Rectangle(Plane=geo, XSize=dom, YSize=dom, Radius=0)  # -> Rectangle, Length
boundary = BoundarySurfaces(Edges=rectangle.Rectangle)
